# Grasshopper definition 01_initialMesh.gh (Grasshopper 1.0.7)
# plug-ins: MeshEdit Components, Bifocals, Kangaroo2 Components

mesh = Mesh(<mesh referenced from the Rhino model>)
mesh_2 = Mesh(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)
mesh_3 = Mesh(<mesh referenced from the Rhino model>)
mesh_4 = Mesh(<mesh referenced from the Rhino model>)
mesh_5 = Mesh(<mesh referenced from the Rhino model>)
mesh_6 = Mesh(<mesh referenced from the Rhino model>)
mesh_7 = Mesh(<mesh referenced from the Rhino model>)
clean = CombineClean(Meshes=mesh)
clean_2 = CombineClean(Meshes=mesh_3)
mesh_8 = Mesh(<mesh referenced from the Rhino model>)
clean_3 = CombineClean(Meshes=mesh_4)
clean_4 = CombineClean(Meshes=mesh_5)
clean_5 = CombineClean(Meshes=mesh_6)
clean_6 = CombineClean(Meshes=mesh_7)
clean_7 = CombineClean(Meshes=mesh_8)
refine = Refine(Mesh=clean_2, Level=Slider(2, range=0..5))
refine_2 = Refine(Mesh=clean_4, Level=Slider(2, range=1..5))
refine_3 = Refine(Mesh=clean_3, Level=Slider(3, range=1..5))
refine_4 = Refine(Mesh=clean_5, Level=Slider(2, range=1..5))
medges = MeshEdges(Mesh=refine)  # -> NakedEdges, InteriorEdges, NonManifoldEdges
refine_5 = Refine(Mesh=clean_6, Level=Slider(3, range=1..5))
refine_6 = Refine(Mesh=clean, Level=Slider(3, range=1..4))
medges_2 = MeshEdges(Mesh=clean)  # -> NakedEdges, InteriorEdges, NonManifoldEdges
refine_7 = Refine(Mesh=clean_7, Level=Slider(3, range=1..5))
medges_3 = MeshEdges(Mesh=refine_3)  # -> NakedEdges, InteriorEdges, NonManifoldEdges
nv = NakedVertices(Mesh=refine)  # -> ClothedIndex, NakedIndex, ClothedPts, NakedPts
bbox = BoundingBox(Content=refine_3, Plane=PlaneXY(0, 0, 0), UnionBox=True)  # -> Box, Box_2
nv_2 = NakedVertices(Mesh=refine_2)  # -> ClothedIndex, NakedIndex, ClothedPts, NakedPts
bbox_2 = BoundingBox(Content=refine, Plane=PlaneXY(0, 0, 0), UnionBox=True)  # -> Box, Box_2
nv_3 = NakedVertices(Mesh=refine_4)  # -> ClothedIndex, NakedIndex, ClothedPts, NakedPts
nv_4 = NakedVertices(Mesh=refine_5)  # -> ClothedIndex, NakedIndex, ClothedPts, NakedPts
join = JoinCurves(Curves=medges_2.NakedEdges, Preserve=False)
join_2 = JoinCurves(Curves=medges_3.NakedEdges, Preserve=False)
nv_5 = NakedVertices(Mesh=refine_7)  # -> ClothedIndex, NakedIndex, ClothedPts, NakedPts
volume = Volume(Geometry=bbox.Box)  # -> Volume, Centroid
nv_6 = NakedVertices(Mesh=refine_3)  # -> ClothedIndex, NakedIndex, ClothedPts, NakedPts
nv_7 = NakedVertices(Mesh=refine_6)  # -> ClothedIndex, NakedIndex, ClothedPts, NakedPts
edgelengths = EdgeLengths(Mesh=refine_6, LengthFactor=0, Strength=1)
show = Show(G=refine_6)
volume_2 = Volume(Geometry=bbox_2.Box)  # -> Volume, Centroid

join_3 = JoinCurves(Curves=medges.NakedEdges, Preserve=False)
explode = Explode(Curve=join_3, Recursive=True)  # -> Segments, Vertices
cullpt = CullDuplicates(Points=explode.Vertices, Tolerance=0.1, CullMode=1)  # -> Points, Indices, Valence
vec2pt = Vector2Pt(PointA=volume_2.Centroid, PointB=cullpt.Points, Unitize=invert(False))  # -> Vector, Length
amp = Amplitude(Vector=vec2pt.Vector, Amplitude=Slider(7, range=0..20))
move = Move(Geometry=cullpt.Points, Motion=amp)  # -> Geometry, Transform
pline = PolyLine(Vertices=move.Geometry, Closed=invert(False))
smoothpline = SmoothPolyline(Polyline=pline, Strength=1, Times=Slider(20, range=0..20))  # -> simplify(Polyline)

crv_cp = CurveClosestPoint(Point=graft(nv.NakedPts), Curve=join_3)  # -> Point, Parameter, Distance
medges_4 = MeshEdges(Mesh=refine_4)  # -> NakedEdges, InteriorEdges, NonManifoldEdges
medges_5 = MeshEdges(Mesh=refine_5)  # -> NakedEdges, InteriorEdges, NonManifoldEdges
explode_2 = Explode(Curve=join, Recursive=True)  # -> Segments, Vertices
explode_3 = Explode(Curve=join_2, Recursive=True)  # -> Segments, Vertices
medges_6 = MeshEdges(Mesh=refine_7)  # -> NakedEdges, InteriorEdges, NonManifoldEdges
nakededge = MeshNakedEdge(Mesh=refine_4)  # -> V, A, B
nakededge_2 = MeshNakedEdge(Mesh=refine_5)  # -> V, A, B
crv = Curve(medges_4.NakedEdges)
pt = Point(Point(0, 0, 0))
crv_2 = Curve(medges_5.NakedEdges)
nakededge_3 = MeshNakedEdge(Mesh=refine_7)  # -> V, A, B
fsim = FindSimilarMember(Data="0", Set=crv_cp.Distance)  # -> Hit, flatten(Index)
cullpt_2 = CullDuplicates(Points=explode_3.Vertices, Tolerance=0.1, CullMode=1)  # -> Points, Indices, Valence
end = EndPoints(Curve=explode_2.Segments)  # -> Start, End
crv_3 = Curve(medges_6.NakedEdges)
join_4 = JoinCurves(Curves=crv, Preserve=False)
pdecon = Deconstruct(Point=nv_7.NakedPts)  # -> XComponent, YComponent, ZComponent
join_5 = JoinCurves(Curves=crv_2, Preserve=False)
pdecon_2 = Deconstruct(Point=nv_6.NakedPts)  # -> XComponent, YComponent, ZComponent
join_6 = JoinCurves(Curves=crv_3, Preserve=False)
sift = SiftPattern(List=nv.NakedPts, SiftPattern=fsim.Index)  # -> Output0, Output1, Output2
vec2pt_2 = Vector2Pt(PointA=pt, PointB=end.Start, Unitize=True)  # -> Vector, Length
vec2pt_3 = Vector2Pt(PointA=volume.Centroid, PointB=cullpt_2.Points, Unitize=invert(False))  # -> Vector, Length
item = ListItem(List=nakededge.V, Index=nakededge.A, Wrap=True)
item_2 = ListItem(List=nakededge_2.V, Index=nakededge_2.A, Wrap=True)
smaller = SmallerThan(FirstNumber=pdecon.YComponent, SecondNumber="0")  # -> SmallerThan, OrEqualTo
len = Length(Curve=join_4)
avr = Average(Input=pdecon_2.YComponent)
len_2 = Length(Curve=join_5)
item_3 = ListItem(List=nakededge_3.V, Index=nakededge_3.A, Wrap=True)
clean_8 = CleanTree(RemoveNulls=True, RemoveInvalid=True, RemoveEmpty=invert(False), Tree=sift.Output0)
clean_9 = CleanTree(RemoveNulls=True, RemoveInvalid=True, RemoveEmpty=invert(False), Tree=sift.Output1)
clean_10 = CleanTree(RemoveNulls=True, RemoveInvalid=True, RemoveEmpty=invert(False), Tree=sift.Output2)
len_3 = Length(Curve=join_6)
multiplication = Multiplication(A=vec2pt_2.Vector, B=15)
amp_2 = Amplitude(Vector=vec2pt_3.Vector, Amplitude=Slider(9, range=0..100))
dispatch = Dispatch(List=nv_7.NakedPts, DispatchPattern=smaller.SmallerThan)  # -> ListA, ListB
sort = SortList(Keys=len, ValuesA=join_4)  # -> Keys, reverse(ValuesA)
sort_2 = SortList(Keys=len_2, ValuesA=join_5)  # -> Keys, reverse(ValuesA)
smaller_2 = SmallerThan(FirstNumber=pdecon_2.YComponent, SecondNumber=avr)  # -> SmallerThan, OrEqualTo
panel = Panel("""0
1
2""")
panel_2 = Panel("""0
1
2""")
sort_3 = SortList(Keys=len_3, ValuesA=join_6)  # -> Keys, reverse(ValuesA)
intcrv = Interpolate(Vertices=multiplication, Degree=3, Periodic=True, KnotStyle=1)  # -> Curve, Length, Domain
entwine = Entwine(Branch00=dispatch.ListA, Branch01=dispatch.ListB, FlattenInputs=True)  # -> simplify(Result)
move_2 = Move(Geometry=cullpt_2.Points, Motion=amp_2)  # -> Geometry, Transform
entwine_2 = Entwine(Branch00=clean_8, Branch01=clean_9, Branch02=clean_10, FlattenInputs=True)  # -> simplify(Result)
panel_3 = Panel("""0
1
2""")
item_4 = ListItem(List=sort.ValuesA, Index=panel, Wrap=True)
dispatch_2 = Dispatch(List=nv_6.NakedPts, DispatchPattern=smaller_2.SmallerThan)  # -> ListA, ListB
item_5 = ListItem(List=sort_2.ValuesA, Index=panel_2, Wrap=True)
crv_4 = Curve(simplify(intcrv.Curve))

crv_5 = Curve(<curve referenced from the Rhino model>)
crv_6 = Curve(<curve referenced from the Rhino model>)
crv_7 = Curve(<curve referenced from the Rhino model>)
entwine_3 = Entwine(Branch00=crv_7, Branch01=crv_5, Branch02=crv_6, FlattenInputs=True)  # -> simplify(Result)

crv_8 = Curve(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)
pline_2 = PolyLine(Vertices=move_2.Geometry, Closed=invert(False))
item_6 = ListItem(List=sort_3.ValuesA, Index=panel_3, Wrap=True)
explode_4 = Explode(Curve=item_4, Recursive=True)  # -> Segments, Vertices
entwine_4 = Entwine(Branch00=dispatch_2.ListA, Branch01=dispatch_2.ListB, FlattenInputs=True)  # -> simplify(Result)
explode_5 = Explode(Curve=item_5, Recursive=True)  # -> Segments, Vertices
oncurve = OnCurve(Points=entwine, Curve=crv_4, Strength=100)
explode_6 = Explode(Curve=item_6, Recursive=True)  # -> Segments, Vertices
smoothpline_2 = SmoothPolyline(Polyline=pline_2, Strength=1, Times=Slider(15, range=0..20))
edgelengths_2 = EdgeLengths(Mesh=refine_3, LengthFactor=Slider(1, range=0..1), Strength=1)
reset = Button()
on = BooleanToggle(True)
oncurve_2 = OnCurve(Points=entwine_4, Curve=smoothpline_2, Strength=Slider(100, range=0..100))
show_2 = Show(G=refine_3)
edgelengths_3 = EdgeLengths(Mesh=refine, LengthFactor=Slider(0, range=0..1), Strength=1)
entwine_5 = Entwine(Branch00=show, Branch01=[oncurve, edgelengths], FlattenInputs=True)
anchor = Anchor(Point=nv.NakedPts, Strength=10000)  # disabled
edgelengths_4 = EdgeLengths(Mesh=refine_2, LengthFactor=Slider(0.1, range=0..1), Strength=1)
oncurve_3 = OnCurve(Points=entwine_2, Curve=entwine_3, Strength="100")
edgelengths_5 = EdgeLengths(Mesh=refine_4, LengthFactor=Slider(0, range=0..1), Strength=1)
show_3 = Show(G=refine)
anchor_2 = Anchor(Point=nv_2.NakedPts, Strength=10000)
edgelengths_6 = EdgeLengths(Mesh=refine_5, LengthFactor=Slider(0.3, range=0..1), Strength=1)
anchor_3 = Anchor(Point=explode_4.Vertices, Strength=10000)
show_4 = Show(G=refine_2)
anchor_4 = Anchor(Point=explode_5.Vertices, Strength=10000)
edgelengths_7 = EdgeLengths(Mesh=refine_7, LengthFactor=Slider(0, range=0..1), Strength=1)
show_5 = Show(G=refine_4)
show_6 = Show(G=refine_5)
anchor_5 = Anchor(Point=explode_6.Vertices, Strength=10000)
solver = Solver(GoalObjects=entwine_5, Reset=reset, Threshold=1e-15, Tolerance=0.01, On=on)  # -> I, V, O
show_7 = Show(G=refine_7)
entwine_6 = Entwine(Branch00=show_2, Branch01=edgelengths_2, Branch03=oncurve_2, FlattenInputs=True)
entwine_7 = Entwine(Branch00=show_3, Branch01=edgelengths_3, Branch02=anchor, Branch03=oncurve_3, FlattenInputs=True)
entwine_8 = Entwine(Branch00=show_4, Branch01=edgelengths_4, Branch02=anchor_2, FlattenInputs=True)
entwine_9 = Entwine(Branch00=show_5, Branch01=edgelengths_5, Branch02=anchor_3, FlattenInputs=True)
entwine_10 = Entwine(Branch00=show_6, Branch01=edgelengths_6, Branch02=anchor_4, FlattenInputs=True)
bang = ExplodeTree(Data=solver.O)  # -> Branch0, Branch1
entwine_11 = Entwine(Branch00=show_7, Branch01=edgelengths_7, Branch02=anchor_5, FlattenInputs=True)
solver_2 = Solver(GoalObjects=entwine_6, Reset=Button(), Threshold=1e-15, Tolerance=0.01, On=Toggle(True))  # -> I, V, O
solver_3 = Solver(GoalObjects=entwine_7, Reset=Button(), Threshold=1e-15, Tolerance=0.01, On=Toggle(True))  # -> I, V, O
solver_4 = Solver(GoalObjects=entwine_8, Reset=Button(), Threshold=1e-15, Tolerance=0.01, On=Toggle(True))  # -> I, V, O
solver_5 = Solver(GoalObjects=entwine_9, Reset=Button(), Threshold=1e-15, Tolerance=0.01, On=Toggle(True))  # -> I, V, O
solver_6 = Solver(GoalObjects=entwine_10, Reset=Button(), Threshold=1e-15, Tolerance=0.01, On=Toggle(True))  # -> I, V, O
mesh_9 = Mesh(bang.Branch0)
solver_7 = Solver(GoalObjects=entwine_11, Reset=Button(), Threshold=1e-15, Tolerance=0.01, On=Toggle(True))  # -> I, V, O
bang_2 = ExplodeTree(Data=solver_2.O)  # -> Branch0, Branch1, Branch2
bang_3 = ExplodeTree(Data=solver_3.O)  # -> Branch0, Branch1, Branch2
bang_4 = ExplodeTree(Data=solver_4.O)  # -> Branch0, Branch1, Branch2
bang_5 = ExplodeTree(Data=solver_5.O)  # -> Branch0, Branch1, Branch2
bang_6 = ExplodeTree(Data=solver_6.O)  # -> Branch0, Branch1, Branch2
mesh_10 = Mesh(bang_2.Branch0)
bang_7 = ExplodeTree(Data=solver_7.O)  # -> Branch0, Branch1, Branch2
mesh_11 = Mesh(bang_3.Branch0)
mesh_12 = Mesh(bang_4.Branch0)
mesh_13 = Mesh(bang_5.Branch0)
mesh_14 = Mesh(bang_6.Branch0)
mesh_15 = Mesh(bang_7.Branch0)
