# Grasshopper definition 0530_meshRelaxation.gh (Grasshopper 1.0.7)
# plug-ins: Bifocals, Kangaroo2 Components

mesh = Mesh(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)
clean = CombineClean(Meshes=mesh)
refine = Refine(Mesh=clean, Level=Slider(3, range=1..4))
medges = MeshEdges(Mesh=refine)  # -> NakedEdges, InteriorEdges, NonManifoldEdges
join = JoinCurves(Curves=medges.NakedEdges, Preserve=False)
nv = NakedVertices(Mesh=refine)  # -> ClothedIndex, NakedIndex, ClothedPts, NakedPts
explode = Explode(Curve=join, Recursive=True)  # -> Segments, Vertices
bbox = BoundingBox(Content=refine, Plane=PlaneXY(0, 0, 0), UnionBox=True)  # -> Box, Box_2
volume = Volume(Geometry=bbox.Box)  # -> Volume, Centroid
vec2pt = Vector2Pt(PointA=explode.Vertices, PointB=volume.Centroid, Unitize=False)  # -> Vector, Length
amp = Amplitude(Vector=vec2pt.Vector, Amplitude=expr("-x", Slider(3.5, range=0..10)))
pdecon = Deconstruct(Point=nv.NakedPts)  # -> XComponent, YComponent, ZComponent
pdecon_2 = Deconstruct(Point=volume.Centroid)  # -> XComponent, YComponent, ZComponent
larger = LargerThan(FirstNumber=pdecon.XComponent, SecondNumber=pdecon_2.XComponent)  # -> LargerThan, OrEqualTo
move = Move(Geometry=explode.Vertices, Motion=amp)  # -> Geometry, Transform
pline = PolyLine(Vertices=move.Geometry, Closed=invert(False))

number_slider = Slider(0.5, range=0..2)
bang = ExplodeTree(Data=pline)  # -> _0000, _0001
pcen = PolygonCenter(Polyline=bang._0000)  # -> CenterV, CenterE, CenterA
X = UnitX(Factor=1)
pcen_2 = PolygonCenter(Polyline=bang._0001)  # -> CenterV, CenterE, CenterA
rot3d = Rotate3D(Geometry=bang._0000, Angle=number_slider, Center=pcen.CenterV, Axis=X)  # -> Geometry, Transform
rot3d_2 = Rotate3D(Geometry=bang._0001, Angle=expr("-x", number_slider), Center=pcen_2.CenterV, Axis=X)  # -> Geometry, Transform
entwine = Entwine(Branch00=rot3d.Geometry, Branch01=rot3d_2.Geometry, FlattenInputs=True)

dispatch = Dispatch(List=nv.NakedPts, DispatchPattern=larger.LargerThan)  # -> ListA, ListB
entwine_2 = Entwine(Branch00=dispatch.ListA, Branch01=dispatch.ListB, FlattenInputs=True)
smoothpline = SmoothPolyline(Polyline=entwine, Strength=1, Times=Slider(25, range=0..100))  # -> graft(Polyline)
edgelengths = EdgeLengths(Mesh=refine, LengthFactor="0", Strength=1)
oncurve = OnCurve(Points=entwine_2, Curve=smoothpline, Strength=Slider(100, range=0..100))
show = Show(G=refine)
entwine_3 = Entwine(Branch00=show, Branch01=edgelengths, Branch02=oncurve, FlattenInputs=True)
solver = Solver(GoalObjects=entwine_3, Reset=Button(), Threshold=1e-15, Tolerance=0.01, On=Toggle(True))  # -> I, V, simplify(O)
bang_2 = ExplodeTree(Data=solver.O)  # -> Branch0, Branch1, Branch2
mesh_2 = Mesh(bang_2.Branch0)
