# Grasshopper definition 0530_meshSegmentation.gh (Grasshopper 1.0.7)
# plug-ins: Bifocals, Weaverbird, Kangaroo2 Components

mesh = Mesh(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)
bbox = BoundingBox(Content=mesh, Plane=PlaneXY(0, 0, 0))  # -> Box, Box_2
boxprop = BoxProperties(Box=bbox.Box)  # -> Center, Diagonal, Area, Volume, Degeneracy
pdecon = Deconstruct(Point=boxprop.Diagonal)  # -> XComponent, YComponent, ZComponent
max = Maximum(A=pdecon.XComponent, B=pdecon.YComponent)
max_2 = Maximum(A=max, B=pdecon.ZComponent)
material = CreateMaterial(
    Diffuse=RGB(255, 105, 180),
    Specular=RGB(255, 255, 255),
    Emission=RGB(0, 0, 0),
    Transparency=Slider(0.8, range=0..1),
    Shine=0)
pt = Point(Point(29.03146499, -168.4625773, 0))
mat_thickness = Slider(0.035, range=0..6)
gap_depth = Slider(0.3, range=0.1..0.3)
tagoffset = Slider(0.7, range=0..10)
division = Division(A=gap_depth, B="2")
subtraction = Subtraction(A=gap_depth, B=division)
addition = Addition(A=gap_depth, B=division)

targetsize = Panel("60")

division_2 = Division(A=targetsize, B=max_2)
scale = Scale(Geometry=mesh, Center=boxprop.Center, Factor=division_2)  # -> Geometry, Transform

bbox_2 = BoundingBox(Content=scale.Geometry, Plane=PlaneXY(0, 0, 0))  # -> Box, Box_2
edges = BrepEdges(Brep=bbox_2.Box)  # -> Naked, Interior, NonManifold
item = ListItem(List=edges.Interior, Index=0, Wrap=True)
linedim = LineDimension(Line=item, Text="{0:0.00}", Size=1)

stripper = Stripper(Mesh=scale.Geometry)

# ---- group: CheckStrip
unroller = Unroller(Strip=stripper, Unroll="1")
facen = FaceNormals(Mesh=unroller)  # -> Centers, Normals
facen_2 = FaceNormals(Mesh=stripper)  # -> Centers, Normals
item_2 = ListItem(List=facen.Centers, Index=0, Wrap=True)
item_3 = ListItem(List=facen_2.Centers, Index=0, Wrap=True)
fsim = FindSimilarMember(Data=flatten(item_3), Set=flatten(item_2))  # -> Hit, simplify(graft(Index))
tstat = TreeStatistics(Tree=fsim.Index)  # -> simplify(Paths), Length, Count
dpath = DeconstructPath(Branch=tstat.Paths)  # -> simplify(Indices)
equals = Equality(FirstNumber=dpath, SecondNumber=fsim.Index)  # -> flatten(Equality), Inequality
dispatch = Dispatch(List=stripper, DispatchPattern=equals.Equality)  # -> ListA, ListB
mjoin = MeshJoin(Meshes=dispatch.ListB)
turn = MeshTurn(Mesh=mjoin)
stripper_2 = Stripper(Mesh=turn)
merge = Merge(Data1=dispatch.ListA, Data2=stripper_2)  # -> flatten(Result)
unroller_2 = Unroller(Strip=merge, Unroll=Slider(1, range=0..1))

# ----
preview = CustomPreview(Geometry=scale.Geometry, Material=material)
unroller_3 = Unroller(Strip=stripper, Unroll="1")
linearlayout = LinearLayout(B=Slider(2.4, range=0..5), mesh=unroller_3, pt=pt)
wbnaked = WeaverbirdsNakedBoundary(MeshClosedPolylines=stripper)
wbnaked_2 = WeaverbirdsNakedBoundary(MeshClosedPolylines=scale.Geometry)
wbnaked_3 = WeaverbirdsNakedBoundary(MeshClosedPolylines=linearlayout)
explode = Explode(Curve=wbnaked, Recursive=True)  # -> Segments, Vertices
explode_2 = Explode(Curve=wbnaked_3, Recursive=True)  # -> Segments, Vertices
curvepoint = PointOnCurve(explode.Segments, parameter=0.5)
colom = CollisionOneMany(Collider=curvepoint, Obstacles=wbnaked_2)  # -> Collision, Index
dispatch_2 = Dispatch(List=explode.Segments, DispatchPattern=colom.Collision)  # -> ListA, ListB
dispatch_3 = Dispatch(List=explode_2.Segments, DispatchPattern=colom.Collision)  # -> ListA, ListB
_3d_stripe = Curve(dispatch_2.ListB)

_2d_stripetabedge = Curve(dispatch_3.ListB)
_2d_stripenakededge = Curve(dispatch_3.ListA)

flip = FlipCurve(Curve=_2d_stripetabedge)  # -> Curve, Flag
end = EndPoints(Curve=flip.Curve)  # -> graft(Start), graft(End)
offset = OffsetCurve(Curve=flip.Curve, Distance=mat_thickness, Plane=PlaneXY(0, 0, 0), Corners=1)
offset_2 = OffsetCurve(Curve=flip.Curve, Distance=tagoffset, Plane=PlaneXY(0, 0, 0), Corners=1)
eval = EvaluateCurve(Curve=reparameterize(flip.Curve), Parameter=subtraction)  # -> graft(Point), Tangent, Angle
eval_2 = EvaluateCurve(Curve=reparameterize(offset_2), Parameter=subtraction)  # -> Point, Tangent, Angle
eval_3 = EvaluateCurve(Curve=reparameterize(offset_2), Parameter=expr("1-x", subtraction))  # -> Point, Tangent, Angle
eval_4 = EvaluateCurve(Curve=reparameterize(offset), Parameter=expr("1-x", subtraction))  # -> Point, Tangent, Angle
eval_5 = EvaluateCurve(Curve=reparameterize(offset), Parameter=expr("1-x", addition))  # -> Point, Tangent, Angle
eval_6 = EvaluateCurve(Curve=reparameterize(flip.Curve), Parameter=expr("1-x", addition))  # -> graft(Point), Tangent, Angle
merge_2 = Merge(
    Data1=simplify(end.Start),
    Data2=simplify(eval.Point),
    Data3=simplify(eval_2.Point),
    Data4=simplify(eval_3.Point),
    Data5=simplify(eval_4.Point),
    Data6=simplify(eval_5.Point),
    Data7=simplify(eval_6.Point),
    Data8=simplify(end.End))
pline = PolyLine(Vertices=merge_2, Closed=False)
fillet = Fillet(Curve=pline, Radius="0.2")
pshift = ShiftPaths(Data=fillet, Offset=-1)
merge_3 = Merge(Data1=simplify(_2d_stripenakededge), Data2=simplify(pshift))
join = JoinCurves(Curves=merge_3, Preserve=False)

# ---- group: dimCheck
bbox_3 = BoundingBox(Content=join, Plane=PlaneXY(0, 0, 0))  # -> Box, Box_2
wires = BrepWireframe(Brep=bbox_3.Box, Density=-1)
item_4 = ListItem(List=wires, Index=0, Wrap=True)  # -> Item, Item1
len = Length(Curve=wires)
bnd = Bounds(Numbers=flatten(len))
linedim_2 = LineDimension(Line=[item_4.Item, item_4.Item1], Text="{0:0.00}", Size=1)
panel = Panel(bnd)

# ---- group: FabRoute
crv = Curve(join)

# ==== cluster LinearLayout: LinearLayout
pt = ClusterInput()

# ---- group: Cluster Input
mesh = ClusterInput()

# ----
mesh_2 = Mesh(graft(mesh))
pt_2 = Point(pt)
B = ClusterInput()

# ---- group: laying out
explode = MeshExplode(Mesh=mesh_2, Interpolate=False)
item = ListItem(List=explode, Index=0, Wrap=True)
item_2 = ListItem(List=explode, Index=-1, Wrap=True)
facen = FaceNormals(Mesh=item)  # -> Centers, Normals
facen_2 = FaceNormals(Mesh=item_2)  # -> Centers, Normals
pl = PlaneNormal(Origin=facen.Centers, ZAxis=facen.Normals)
vec2pt = Vector2Pt(PointA=facen.Centers, PointB=facen_2.Centers, Unitize=False)  # -> Vector, Length
align = AlignPlane(Plane=pl, Direction=vec2pt.Vector)  # -> flatten(Plane), Angle
bbox = BoundingBox(Content=mesh_2, Plane=graft(align.Plane))  # -> flatten(Box), Box_2
box_corners = BoxCorners(Box=bbox.Box)  # -> CornerA, CornerB, CornerC, CornerD, CornerE, CornerF, CornerG, CornerH
pl_origin = PlaneOrigin(Base=align.Plane, Origin=box_corners.CornerD)
debox = DeconstructBox(Box=bbox.Box)  # -> Plane, X, Y, Z
dedomain = DeconstructDomain(Domain=debox.Y)  # -> Start, End
xy = XYPlane(Origin=pt_2)
rotate = Rotate(Geometry=xy, Angle=1.570796327, Plane=PlaneXY(0, 0, 0))  # -> Geometry, Transform

# ----
subtraction = Subtraction(A=dedomain.End, B=dedomain.Start)

# ---- group: laying out (continued)
ma = MassAddition(Input=subtraction)  # -> Result, PartialResults
X = UnitX(Factor=ma.PartialResults)

# ----
multiplication = Multiplication(A=X, B=B)

# ---- group: laying out (continued)
neg = Negative(Value=multiplication)
move = Move(Geometry=rotate.Geometry, Motion=neg)  # -> Geometry, Transform
pln = Plane(move.Geometry)

# ----
orient = Orient(Geometry=flatten(mesh_2), Source=pl_origin, Target=pln)  # -> Geometry, Transform

# ---- group: Cluster Output
G = ClusterOutput(orient.Geometry)
