# Grasshopper definition 0531_fabLayout.gh (Grasshopper 1.0.7)
# plug-ins: OpenNest

# ---- group: InputRoute
crv = Curve(flatten([<curve referenced from the Rhino model> x40]))

# ----
scale = Scale(Geometry=crv, Center=Point(0, 0, 0), Factor="10")  # -> Geometry, Transform
lng = ListLength(List=crv)
series = Series(Start=0, Step=1, Count=lng)
rectangle = Rectangle(Plane=PlaneXY(0, 0, 0), XSize="790", YSize="550", Radius=0)  # -> Rectangle, Length

boundary = BoundarySurfaces(Edges=scale.Geometry)

area = Area(Geometry=boundary)  # -> Area, Centroid
pdecon = Deconstruct(Point=area.Centroid)  # -> XComponent, YComponent, ZComponent
sort = SortList(Keys=pdecon.XComponent, ValuesA=boundary)  # -> Keys, reverse(ValuesA)
area_2 = Area(Geometry=sort.ValuesA)  # -> Area, Centroid
bbox = BoundingBox(Content=sort.ValuesA, Plane=PlaneXY(0, 0, 0))  # -> Box, Box_2
debrep = DeconstructBrep(Brep=bbox.Box)  # -> Faces, Edges, Vertices
item = ListItem(List=debrep.Faces, Index="4", Wrap=True)  # -> flatten(Item)
text = Text(Location=area_2.Centroid, Text=series, Size=Slider(10, range=0..100))
opennest = OpenNest(
    Sheets=rectangle.Rectangle,
    Geo=item,
    Spacing="10",
    Placement=1,
    Tolerance=0.1,
    Rotations=4,
    Iterations=1,
    Seed=1,
    Reset=True,
    Run=False)  # -> Sheets, Geo, ID, Transform, IDS
transform = Transform(Geometry=text, Transform=graft(opennest.Transform))  # -> simplify(Geometry)
transform_2 = Transform(Geometry=graft(sort.ValuesA), Transform=graft(opennest.Transform))  # -> simplify(Geometry)

# ---- group: FabFile
font = Curve(transform)
# Bake route curves
# Bake font for another layer
# 
# *.dxf (r12)
route = Curve(transform_2)
